# Grasshopper definition AGGREGATE.gh (Grasshopper 1.0.7)
# plug-ins: FileToScript

panel = Panel("BeaverComponent.cs")  # disabled
dir_type = ValueList({"desktop": 0, "documents": 1, "GH file path": 2, "C:": 3}, selected="GH file path")  # disabled
f_ghfilepath = GHFilePathInfo()  # -> F, P; disabled
# ---------- f_ghfilepath: C# ----------
                                      /*
    froGH - a sparse collection of (in)utilities for Grasshopper

    GH File and Path info

    code by Alessio Erioli

    froGH by Co-de-iT is licensed under a Creative Commons Attribution 4.0 International License.
    http://creativecommons.org/licenses/by/4.0/

    */

    initComp();

    GH_Document ghDoc = Grasshopper.Instances.ActiveCanvas.Document;

    int nameLen = ghDoc.DisplayName.TrimEnd('*').Length + 3; // +3 accounts for the '.gh' extension
    int fileLen = ghDoc.FilePath.TrimEnd('*').Length;

    F = ghDoc.DisplayName.TrimEnd('*');
    P = ghDoc.FilePath.Substring(0, fileLen - nameLen);
# ---------- f_ghfilepath: C# additional code ----------
  void initComp(){

    Component.Name = "GH File Path Info";
    Component.NickName = "f_GHFilePath";
    Component.Description = "Provides info on current Grasshopper Document file name and path\nUseful for exporting files with the same name as the gh file and in the same directory";
    Component.Params.Output[0].Name = "File Name";
    Component.Params.Output[0].Description = "Current GH file name";
    Component.Params.Output[1].Name = "File Path";
    Component.Params.Output[1].Description = "Current GH file path";
  }
# ---------- end f_ghfilepath ----------
panel_2 = Panel("Beaver\Beaver")  # disabled
panel_3 = Panel(f_ghfilepath.P)  # disabled
f_pathg = PathGenerator(type=dir_type, subDir=panel_2)  # -> dir; inputs type: Int32, subDir: String; disabled
# ---------- f_pathg: C# ----------
                           /*
    froGH - a sparse collection of (in)utilities for Grasshopper

    Path Generator
    code by Alessio Erioli - value list generation based on code by James Ramsden

    froGH by Co-de-iT is licensed under a Creative Commons Attribution 4.0 International License.
    http://creativecommons.org/licenses/by/4.0/

    */
    initComp();


    String S = "";
    String root = "";
    String end = "\\";
    String eol = Environment.NewLine;

    // __________________ autoList part __________________

    // variable for the list
    Grasshopper.Kernel.Special.GH_ValueList vList;
    // tries to cast input as list
    try{

      // if the list is not the first parameter then change Input[0] to the corresponding value
      vList = (Grasshopper.Kernel.Special.GH_ValueList) Component.Params.Input[0].Sources[0];
      // Print("value list connected");
      // check if the list must be created
      //if (vList.NickName != "dir type"){
      if (!vList.NickName.Equals("dir type")){
        vList.ClearData();
        vList.ListItems.Clear();
        vList.NickName = "dir type";
        var item1 = new Grasshopper.Kernel.Special.GH_ValueListItem("desktop", "0");
        var item2 = new Grasshopper.Kernel.Special.GH_ValueListItem("documents", "1");
        var item3 = new Grasshopper.Kernel.Special.GH_ValueListItem("GH file path", "2");
        var item4 = new Grasshopper.Kernel.Special.GH_ValueListItem("C:", "3");
        vList.ListItems.Add(item1);
        vList.ListItems.Add(item2);
        vList.ListItems.Add(item3);
        vList.ListItems.Add(item4);

        vList.ListItems[0].Value.CastTo(out type);
      }
    }
    catch{
      // handles anything that is not a value list
    }


    switch(type){
      case 0:
        root = Environment.GetFolderPath(Environment.SpecialFolder.Desktop) + end;
        S = "Desktop";
        break;
      case 1:
        root = Environment.GetFolderPath(Environment.SpecialFolder.MyDocuments) + end;
        S = "Documents";
        break;
      case 2:
        GH_Document ghDoc = owner.OnPingDocument();

        if (ghDoc.IsFilePathDefined)
        {
          int nameLen = ghDoc.DisplayName.TrimEnd('*').Length + 3; // +3 accounts for the '.gh' extension
          int fileLen = ghDoc.FilePath.TrimEnd('*').Length;

          //F = ghDoc.DisplayName.TrimEnd('*');
          root = ghDoc.FilePath.Substring(0, fileLen - nameLen);
          //root = gh_d.FilePath;
          S = "GH File path";
        }
        else
        {
          Print("No path defined. Saving to Desktop until then");
          root = Environment.GetFolderPath(Environment.SpecialFolder.Desktop);
          S = "Desktop";
        }
        break;
      case 3:
        root = "C:" + end;
        S = root + end;
        break;
    }
    dir = root + (subDir != null ? (subDir + end) : "");
    Component.Message = S;
# ---------- f_pathg: C# additional code ----------
  void initComp(){
    Component.Name = "Path Generator";
    Component.NickName = "f_PathG";
    Component.Description = "generates a path based on local direcories such as Desktop, Documents, GH file path";
    Component.Params.Input[0].Name = "dir type";
    Component.Params.Input[0].Description = "directory type: 0 desktop, 1 documents, 2 GH file path, 3 C:\nconnect a value list for automatic list generation";
    Component.Params.Input[1].Name = "custom subdir";
    Component.Params.Input[1].Description = "(optional) custom subdirectory";
  }
# ---------- end f_pathg ----------
concat = Concatenate(FragmentA=f_pathg, FragmentB=panel)  # disabled

panel_4 = Panel("D:\DESIGN BY DATA\COURSE\97_THESIS\AGGREGATE\BEAVER\BEAVER\BEAVER.cs")
number_slider = Slider(37, range=0..100, expression="x*3")
dom = ConstructDomain(DomainStart="30", DomainEnd="100")
dom_2 = ConstructDomain(DomainStart="700", DomainEnd="2800")
dom_3 = ConstructDomain(DomainStart="30", DomainEnd="100")
series = Series(Start=0, Step=1, Count=number_slider)  # -> flatten(Series)
random = Random(Range=dom, Number=number_slider, Seed=Slider(3, range=0..10))  # -> flatten(Random)
random_2 = Random(Range=dom_2, Number=number_slider, Seed=2)  # -> flatten(Random)
random_3 = Random(Range=dom_3, Number=number_slider, Seed=2)  # -> flatten(Random)
pt = ConstructPoint(XCoordinate=0, YCoordinate=0, ZCoordinate=0)
concat_2 = Concatenate(FragmentB=series)
dup = DuplicateData(Data=pt, Number=number_slider, Order=True)
path = FilePath(panel_4)
c_script = CSharpScript(p=dup, id=series, l=random_2, w=random_3, t=random, aggid=Slider(40, range=0..99))  # -> out, A, B, C, D, E, F; inputs p: list of Point3d, id: list of Int32, l: list of Double, w: list of Double, t: list of Double, aggid: Int32
# ---------- c_script: C# usings ----------
using System.Linq;
# ---------- c_script: C# ----------
        IList<int> ID = new List<int>(_id);
        IList<double> L = new List<double>(_l);
        IList<double> W = new List<double>(_w);
        IList<double> T = new List<double>(_t);
        int IDLength = ID.Count;

        //Create a list of wood bars
        List<element> bars = new List<element>();
        for (int i = 0; i < IDLength; i++)
        {
            element bar = new element(ID[i], L[i], W[i], T[i]);
            bars.Add(bar);
        }

        //Get Wood bars Volume
        List<double> barsVolumes = new List<double>();
        for (int i = 0; i < IDLength; i++)
        {
            double volume = bars.ElementAt(i).Volume;
            barsVolumes.Add(volume);
        }

        //Sort wood bars according to their volume
        List<element> sortedBars = bars.OrderBy(x => x.Volume).ToList();

        //Create a enumerable list of bar
        IList<element> sortedBarList = sortedBars;

        //Create the list of sorted Bars' ID
        IList<int> sortedBarId = new List<int>();
        for (int i = 0; i < IDLength; i++)
        {
            int barId = sortedBarList.ElementAt(i).Id;
            sortedBarId.Add(barId);
        }

        //Create the list of sorted volumes
        IList<double> sortedBarVolume = new List<double>();
        for (int i = 0; i < IDLength; i++)
        {
            double barVolume = sortedBarList.ElementAt(i).Volume;
            sortedBarVolume.Add(barVolume);
        }

        //Create the origin point for the first Aggregate
        var pOrigin = new Point3d(0, 0, 0);

        //Create a list of Aggregates
        IList<Aggregate> aggregateList = new List<Aggregate>();
        for (int i = 0; i < IDLength; i += 3)
        {
            Aggregate agg = new Aggregate(sortedBarList, i, ref pOrigin);
            aggregateList.Add(agg);
        }

        IList<char> OrientationList = new List<char>();
        for (int i = 0; i < aggregateList.Count; i++)
        {
            char xOr = aggregateList.ElementAt(i).ArrElements.ElementAt(0).Orientation;
            char yOr = aggregateList.ElementAt(i).ArrElements.ElementAt(1).Orientation;
            char zOr = aggregateList.ElementAt(i).ArrElements.ElementAt(2).Orientation;
            OrientationList.Add(xOr);
            OrientationList.Add(yOr);
            OrientationList.Add(zOr);
        }

        Assembly assembly = new Assembly();
        assembly.Orientation = assembly.OrientationList(aggregateList);
        assembly.AggL = aggregateList;
        assembly.AssAggL = assembly.ListAssembly(assembly.AggL);

        IList<Point3d> pL = new List<Point3d>();
        for (int i = 0; i < assembly.AssAggL.Count;i++)
        {
            pL.Add(assembly.AssAggL.ElementAt(i).Origin);
        }


        List<Mesh> assemblyMesh = new List<Mesh>();
        for (int i = 1; i < assembly.AssAggL.Count; i++)
        {
            Mesh movedMesh = assembly.AssAggL.ElementAt(i).AggMesh;
            movedMesh.Translate(pL.ElementAt(i).X, pL.ElementAt(i).Y, pL.ElementAt(i).Z);
            assemblyMesh.Add(movedMesh);
        }

        //Give aggregate Id
        //List<string> assemblyId = new List<string>();
        //for (int i = 0; i < assembly.AggL.Count; i++)
        //{
        //    String AggId = assembly.AggL.ElementAt(i).AggName;
        //    assemblyId.Add(AggId);
        //}

        //Create the instruction to assemble Aggregate
        //List<String> AggInstructionsList = new List<String>();
        //for (int i = 0; i < aggregateList.Count ; i++)
        //{
        //    string instruction = aggregateList.ElementAt(i).AggInstructions;
        //    AggInstructionsList.Add(instruction);
        //}



        A = assembly;
        B = assemblyMesh;
        C = aggregateList.Count;
        D = aggregateList;
        E = pL;
        F = "assemblyId";
# ---------- c_script: C# additional code ----------
 

public class Assembly
    {
    //Fields

    private List<Point3d> _assFSpot;
    public List<Point3d> FSpot
    {
        get { return _assFSpot; }
        set { _assFSpot = value; }
    }

    private List<Point3d> _assNfSpot;
    public List<Point3d> NfSpot
    {
        get { return _assNfSpot; }
        set { _assNfSpot = value; }
    }

    private List<int> _assDof;
    public List<int> Dof
    {
        get { return _assDof; }
        set { _assDof = value; }
    }

    private IList<char> _orientation;
    public IList<char> Orientation
    {
        get { return _orientation; }
        set { _orientation = value; }
    }

    private IList<Aggregate> _AggL;
    public IList<Aggregate> AggL
    {
        get { return _AggL; }
        set { _AggL = value; }
    }

    private IList<Aggregate> _assAggL;
    public IList<Aggregate> AssAggL
    {
        get { return _assAggL; }
        set { _assAggL = value; }
    }


    //Constructor
    public Assembly()
        {
        }

    //Methods

    public IList<char> OrientationList(IList<Aggregate> aggregateList)
    {
        List<char> orientationList = new List<char>();
        for (int i = 0; i < aggregateList.Count; i++)
        {
            char xOr = aggregateList.ElementAt(i).ArrElements.ElementAt(0).Orientation;
            char yOr = aggregateList.ElementAt(i).ArrElements.ElementAt(1).Orientation;
            char zOr = aggregateList.ElementAt(i).ArrElements.ElementAt(2).Orientation;
            orientationList.Add(xOr);
            orientationList.Add(yOr);
            orientationList.Add(zOr);
        }
        return orientationList;
    }

    public IList<string> AssemblyInstruction(IList<Aggregate> listagg, int index)
    {
        IList<String> Instruction = new List<string>
        {
        listagg.ElementAt(index).AggName,
        listagg.ElementAt(listagg.Count - 2).AggName,
        listagg.ElementAt(listagg.Count - 1).AggName
        };
        return Instruction;
    }

    /// <summary>NewOrigin:
    /// This method find the relative vector for each Aggregate to be moved to its correct position in the assembly
    /// </summary>
    /// <param name="agg1"></param>
    /// <param name="agg2"></param>
    /// <param name="agg3"></param>
    /// <param name="orientation"></param>
    /// <returns></returns>
    public IList<Point3d> NewOrigin(IList<Aggregate> listagg, char orientation, int index)
    {
        Point3d agg1Origin = listagg.ElementAt(index).Origin;
        Point3d agg2Origin = listagg.ElementAt(listagg.Count - 2).Origin;
        Point3d agg3Origin = listagg.ElementAt(listagg.Count - 1).Origin;
        Point3d origin = new Point3d(0, 0, 0);
        Point3d agg1Freespot = new Point3d();
        Point3d agg2Freespot = new Point3d();
        Point3d agg3Freespot = new Point3d();
        var pList = new List<Point3d>();

        if (orientation == 'X')
        {
            agg1Freespot = listagg.ElementAt(index).XFsPos;
            agg2Freespot = listagg.ElementAt(listagg.Count - 2).YFsPos;
            agg3Freespot = listagg.ElementAt(listagg.Count - 1).ZFsPos;
        }
        else if (orientation == 'Y')
        {
            agg1Freespot = listagg.ElementAt(index).YFsPos;
            agg2Freespot = listagg.ElementAt(listagg.Count - 2).ZFsPos;
            agg3Freespot = listagg.ElementAt(listagg.Count - 1).XFsPos;
        }
        else
        {
            agg1Freespot = listagg.ElementAt(index).ZFsPos;
            agg2Freespot = listagg.ElementAt(listagg.Count - 2).XFsPos;
            agg3Freespot = listagg.ElementAt(listagg.Count - 1).YFsPos;
        }

        Vector3d v1 = new Vector3d(agg1Origin.X - origin.X, agg1Origin.Y - origin.Y, agg1Origin.Z - origin.Z);
        Vector3d v2 = new Vector3d(agg1Freespot.X - agg1Origin.X, agg1Freespot.Y - agg1Origin.Y, agg1Freespot.Z - agg1Origin.Z);
        Vector3d v3 = new Vector3d(agg2Freespot.X - agg2Origin.X, agg2Freespot.Y - agg2Origin.Y, agg2Freespot.Z - agg2Origin.Z);
        Vector3d v4 = new Vector3d(agg3Freespot.X - agg3Origin.X, agg3Freespot.Y - agg3Origin.Y, agg3Freespot.Z - agg3Origin.Z);

        Vector3d vA1 = v1 + v2 + v3;
        Vector3d vA2 = v1 + v2 + v4;

        agg1Origin = origin + vA1;
        agg2Origin = origin + vA2;

        pList.Add(agg1Origin);
        pList.Add(agg2Origin);
        return pList;
    }

    public IList<Aggregate> ListAssembly(IList<Aggregate> AggregateList)
    {
        IList<Aggregate> listAssembly = new List<Aggregate>
        {
            AggregateList.ElementAt(0)
        };
        IList<Point3d> Origin = new List<Point3d>();
        IList<char> OrientationList = new List<char>
        {
            listAssembly.ElementAt(0).ArrElements.ElementAt(0).Orientation,
            listAssembly.ElementAt(0).ArrElements.ElementAt(1).Orientation,
            listAssembly.ElementAt(0).ArrElements.ElementAt(2).Orientation
        };
        IList<int> step = new List<int>
        {
            3
        };

        for (int i = 1; i<5; i++)
        {
            step.Add(step.ElementAt(i-1) * 2);

            int j = step.ElementAt(i - 1) ;
            if (j >= AggregateList.Count)
            {
                break;
            }
            while (j < step.ElementAt(i-1)+step.ElementAt(i))
            {

                int k = (j -2) / 2;
                
                if(k>=OrientationList.Count)
                {
                    break;
                }

                listAssembly.Add(AggregateList.ElementAt(j));
                listAssembly.Add(AggregateList.ElementAt(j + 1));

                IList<Point3d> p = NewOrigin(listAssembly, OrientationList.ElementAt(k), k);

                Origin.Add(p.ElementAt(0));
                Origin.Add(p.ElementAt(1));

                if (OrientationList.ElementAt(k) == 'X')
                {
                    OrientationList.Add('Y');
                    OrientationList.Add('Z');
                }
                else if (OrientationList.ElementAt(k) == 'Y')
                {
                    OrientationList.Add('Z');
                    OrientationList.Add('X');
                }
                else
                {
                    OrientationList.Add('X');
                    OrientationList.Add('Y');
                }

                j += 2;
            }
            if (Origin.Count > AggregateList.Count)
            {
                break;
            }
        }

        for (int i = 0; i <AggregateList.Count; i++)
        {
            if (i>=listAssembly.Count)
            {
                break;
            }
            else if (i>= Origin.Count)
            {
                break;
            }
            listAssembly.ElementAt(i).Origin = Origin.ElementAt(i);
            Vector3d vx = new Vector3d(listAssembly.ElementAt(i).ArrElements.ElementAt(0).Length * 0.7, 0.0, 0.0);
            Vector3d vy = new Vector3d(0.0, listAssembly.ElementAt(i).ArrElements.ElementAt(1).Length * 0.7, 0.0);
            Vector3d vz = new Vector3d(0.0, 0.0, listAssembly.ElementAt(i).ArrElements.ElementAt(2).Length * 0.7);
            listAssembly.ElementAt(i).XFsPos = listAssembly.ElementAt(i).Origin + vx;
            listAssembly.ElementAt(i).YFsPos = listAssembly.ElementAt(i).Origin + vy;
            listAssembly.ElementAt(i).ZFsPos = listAssembly.ElementAt(i).Origin + vz;
        }
        return listAssembly;
    }
        
}


public class Aggregate
{
    //Fields

    private double pi = Math.PI;
    private Vector3d unitVectorX = new Vector3d(1, 0, 0);
    private Vector3d unitVectorY = new Vector3d(0, 1, 0);
    private Vector3d unitVectorZ = new Vector3d(0, 0, 1);
    private Point3d origin = new Point3d(0, 0, 0);

    private Mesh _aggMesh;
    public Mesh AggMesh
    {
        get { return _aggMesh; }
        set { _aggMesh = value; }
    }

    private element[] _aggArrelements;
    public element[] ArrElements
    {
        get { return _aggArrelements; }
        set { _aggArrelements = value; }
    }

    private Point3d agg_Origin;
    public Point3d Origin
    {
        get { return agg_Origin; }
        set { agg_Origin = value; }
    }

    private string agg_name;
    public string AggName
    {
        get { return agg_name; }
        set { agg_name = value; }
    }

    private int _aggXFreedom;
    public int XFreedom
    {
        get { return _aggXFreedom; }
        set { _aggXFreedom = 2; }
    }

    private int _aggYFreedom;
    public int YFreedom
    {
        get { return _aggYFreedom; }
        set { _aggYFreedom = 2; }
    }

    private int _aggZFreedom;
    public int ZFreedom
    {
        get { return _aggZFreedom; }
        set { _aggZFreedom = 2; }
    }

    private Point3d _aggXFsPos;
    public Point3d XFsPos
    {
        get { return _aggXFsPos; }
        set { _aggXFsPos = value; }
    }

    private Point3d _aggYFsPos;
    public Point3d YFsPos
    {
        get { return _aggYFsPos; }
        set { _aggYFsPos = value; }
    }

    private Point3d _aggZFsPos;
    public Point3d ZFsPos
    {
        get { return _aggZFsPos; }
        set { _aggZFsPos = value; }
    }

    private double _aggXPos;
    public double XPos
    {
        get { return _aggXPos; }
        set { _aggXPos = 0.3; }
    }

    private double _aggYPos;
    public double YPos
    {
        get { return _aggYPos; }
        set { _aggYPos = 0.3; }
    }

    private double _aggZPos;
    public double ZPos
    {
        get { return _aggZPos; }
        set { _aggZPos = 0.3; }
    }

    private string _aggInstructions;
    public string AggInstructions
    {
        get { return _aggInstructions; }
        set { _aggInstructions = value; }
    }

    //Constructor

    public Aggregate(IList<element> elements, int i, ref Point3d origin)
    {
        this.ArrElements = Aggregation(elements, i);
        this.AggName = "agg_" + i / 3;
        this.AggInstructions = aggregationInstruction(ArrElements, i);
        this.AggMesh = BuildAggregate(ArrElements, i, ref origin);
        this.Origin = origin;
        this.XPos = 0.3;
        this.YPos = 0.3;
        this.ZPos = 0.3;
        this.XFsPos = xFsPoint(ArrElements.ElementAt(0), Origin);
        this.YFsPos = yFsPoint(ArrElements.ElementAt(1), Origin);
        this.ZFsPos = zFsPoint(ArrElements.ElementAt(2), Origin);
    }


    //Methods

    public element[] Aggregation(IList<element> element, int i)
    {
        element[] arrelements = new element[3] { element[i], element[i + 1], element[i + 2] };
        element[i].Orientation = 'X';
        element[i+1].Orientation = 'Y';
        element[i+2].Orientation = 'Z';
        return arrelements;
    }


    ///<summary>A method to get information from the elements
    ///
    /// </summary>
    public string aggregationInstruction(element[] ArrElements, int i)
    {
       
        int xID = ArrElements.ElementAt(0).Id;
        int yID = ArrElements.ElementAt(1).Id;
        int zID = ArrElements.ElementAt(2).Id;
        char xOr = ArrElements.ElementAt(0).Orientation;
        char yOr = ArrElements.ElementAt(1).Orientation;
        char zOr = ArrElements.ElementAt(2).Orientation;
        string Name = AggName;
        string instructions = string.Format("The beaver kindly asks you to assemble elements {0}, {1} and {2} respectively as the {3}, {4} and {5} elements of the Aggregate named {6}", xID, yID, zID, xOr, yOr,zOr, Name);

        return instructions;
    }
    
    ///<summary>A method to place element along x,y,z axis
    ///
    ///</summary>
    public Mesh BuildAggregate(element[] ArrElements, int i, ref Point3d origin)
    {
        //Compute vector by global and local origin
        var vDirection =  new Vector3d(origin);
        
        //Get boxes representing each element in a Aggregate
        Mesh xMesh = ArrElements.ElementAt(0).Mesh;
        Mesh yMesh = ArrElements.ElementAt(1).Mesh;
        Mesh zMesh = ArrElements.ElementAt(2).Mesh;

        //Get translation vector for each bar
        double xv = ArrElements.ElementAt(0).Length;
        double yv = ArrElements.ElementAt(1).Length;
        double zv = ArrElements.ElementAt(2).Length;
        

        //Move bars to get them at the right position 
        xMesh.Translate(vDirection);
        yMesh.Translate(vDirection);
        zMesh.Translate(vDirection);

        //Move bars to obtain the right position along x
        xMesh.Translate(xv *-0.3, 0, 0);
        yMesh.Translate(yv *-0.3, 0, 0);
        zMesh.Translate(zv *-0.3, 0, 0);

        //Rotate bars to obtain the right position in space
        yMesh.Rotate(pi / 2, unitVectorZ, origin);
        yMesh.Rotate(pi / 2, unitVectorY, origin);
        zMesh.Rotate(-pi / 2, unitVectorX, origin);
        zMesh.Rotate(-pi / 2, unitVectorY, origin);

        //Join bars in one mesh
        List<Mesh> meshList = new List<Mesh> { xMesh, yMesh, zMesh };
        var joinedMesh = new Mesh();
        joinedMesh.Append(meshList);
        
        // return joined Mesh
        return joinedMesh;
    }

    public Point3d xFsPoint(element element, Point3d origin)
    {
        Point3d Fspot = new Point3d();
        Fspot.X = element.Length * 0.5 + origin.X;
        Fspot.Y = origin.Y;
        Fspot.Z = origin.Z;

        return Fspot;
    }

    public Point3d yFsPoint(element element, Point3d origin)
    {
        Point3d Fspot = new Point3d();
        Fspot.X = origin.X;
        Fspot.Y = element.Length * 0.5 + origin.Y;
        Fspot.Z = origin.Z;

        return Fspot;
    }

    public Point3d zFsPoint(element element, Point3d origin)
    {
        Point3d Fspot = new Point3d();
        Fspot.X = origin.X;
        Fspot.Y = origin.Y;
        Fspot.Z = element.Length * 0.5 + origin.Z;


        return Fspot;
    }

}

public class element
{
    //Fields 

    private int ele_Id;
    public int Id
    {
        get { return ele_Id; }
        set { ele_Id = value; }
    }

    private double ele_Length;
    public double Length
    {
        get { return ele_Length; }
        set { ele_Length = value; }
    }

    private double ele_Width;
    public double Width
    {
        get { return ele_Width; }
        set { ele_Width = value; }
    }

    private double ele_Thickness;
    public double Thickness
    {
        get { return ele_Thickness; }
        set { ele_Thickness = value; }
    }

    private double ele_Volume;
    public double Volume
    {
        get { return ele_Volume; }
        set { ele_Volume = value; }
    }

    private char ele_Orientation;
    public char Orientation
    {
        get { return ele_Orientation; }
        set { ele_Orientation = value; }
    }

    private Mesh ele_Mesh;
    public Mesh Mesh
    {
        get { return ele_Mesh; }
        set { ele_Mesh = value; }
    }


    //Constructor
    public element()
    {

    }

    public element(int id, double l, double w, double t)
    {
        this.Id = id;
        this.Length = l;
        this.Width = w;
        this.Thickness = t;
        this.Mesh = Bars(Length, Width, Thickness);
        this.Volume = Mesh.Volume();
    }


    //Methods

    /// <summary>
    /// This function create 3D geometry representing the bar
    /// </summary>
    public Mesh Bars(double l, double w, double t)
    {
        Interval lInterval = new Interval(0, l);
        Interval wInterval = new Interval(-w,0);
        Interval tInterval = new Interval(0,t);
        Rhino.Geometry.Plane pPlane = new Plane(0, 0, 1, 0);
        Rhino.Geometry.Box box = new Box(pPlane, lInterval, wInterval, tInterval);
        var mesh = Mesh.CreateFromBox(box, 1, 1, 1);
        
        return mesh;
    }

}
# ---------- end c_script ----------
panel_5 = Panel(random_2)
panel_6 = Panel(path)
c_script_2 = CSharpScript(x=Slider(0, range=0..100), y=Slider(0, range=0..100), z=Slider(0, range=0..100))  # -> out, A, B; inputs x: Double, y: Double, z: Double
# ---------- c_script_2: C# ----------
    double X = x;

    point point = new point(ref X, y, z);

    A = point.Point;

    X = 2;

    B = point.Point;
# ---------- c_script_2: C# additional code ----------
  public class point
  {
    //fields

    public double X ;
    public double Y ;
    public double Z ;
    public Point3d Point;

    //Constructor

    public point (ref double x, double y, double z)
    {
      this.X = x;
      this.Y = y;
      this.Z = z;
      this.Point = new Point3d(X, Y, Z);
    }
  }

  /// <summary>
  /// This method will be called once every solution, before any calls to RunScript.
  /// </summary>
  public override void BeforeRunScript()
  { }
  /// <summary>
  /// This method will be called once every solution, after any calls to RunScript.
  /// </summary>
  public override void AfterRunScript()
  { }
# ---------- end c_script_2 ----------
ftsv2 = FileToScriptV2(File=path)
cset = CreateSet(List=c_script.E)  # -> Set, Map
panel_7 = Panel(random_3)
mesh = Mesh(c_script.B)
panel_8 = Panel(random)
panel_9 = Panel(c_script.B)
panel_10 = Panel(c_script.E)
panel_11 = Panel(c_script.C)
panel_12 = Panel(c_script.F)
panel_13 = Panel(c_script.D)
panel_14 = Panel(c_script.A)
